# Grasshopper definition 01_isOddisEven_script.gh (Grasshopper 1.0.7)

# ---- group: exercise_1 / rotationAngle
number_slider = Slider(56, range=0..100)
number_slider_2 = Slider(286, range=0..360)

number_slider_3 = Slider(34, range=0..100)
number_slider_4 = Slider(293, range=0..360)

# ---- group: exercise_1 / rotationAxisVector
number_slider_5 = Slider(1.83, range=0..5)
number_slider_6 = Slider(2.25, range=0..5)
number_slider_7 = Slider(3.36, range=0..5)

number_slider_8 = Slider(2.46, range=0..5)
number_slider_9 = Slider(2.28, range=0..5)
number_slider_10 = Slider(3.11, range=0..5)

# ---- group: exercise_1 / scaleFactor
number_slider_11 = Slider(0.8, range=0..1)
number_slider_12 = Slider(0.9, range=0..1)

number_slider_13 = Slider(0.9, range=0..1)
number_slider_14 = Slider(1, range=0..1)

# ---- group: exercise_1 / rotationAxisVector
number_slider_15 = Slider(10, range=0..10)
number_slider_16 = Slider(5.21, range=0..10)
number_slider_17 = Slider(0, range=0..10)

number_slider_18 = Slider(0, range=0..10)
number_slider_19 = Slider(0, range=0..10)
number_slider_20 = Slider(2.36, range=0..10)

# ---- group: exercise_1 / pipeRadius
number_slider_21 = Slider(0.2, range=0..1)

# ---- group: exercise_1
genes = GenePool(
    Decimals=2,
    Maximum=100,
    Minimum=0,
    Value=[82.49011829, 71.75347131, 76.71113056, 51.97032245, 71.10485852, 54.98230519, 10.99972607, 62.27297527, 43.26011962, 66.56107495])
number_slider_22 = Slider(4, range=0..10)

# ---- group: exercise_1 / isEven/isOdd_Script
c_script = CSharpScript(x=genes)  # -> out, isOdd, isEven; inputs x: Int32
# ---------- c_script: C# ----------
    int mod1 = x % 2;
    isOdd = (mod1 != 0 ? true : false);

    int mod2 = x % 2;
    isEven = (mod2 == 0 ? true : false);
# ---------- end c_script ----------

# ---- group: exercise_1 (continued)
multiplication = Multiplication(A=c_script.isOdd, B=number_slider_22)
multiplication_2 = Multiplication(A=c_script.isEven, B=number_slider_22)
Z = UnitZ(Factor=multiplication)
Y = UnitY(Factor=multiplication_2)

box = CenterBox(Base=PlaneXY(0, 0, 0), X=1, Y=1, Z=1)
move = Move(Geometry=box, Motion=Y)  # -> Geometry, Transform
dom = ConstructDomain(DomainStart=number_slider, DomainEnd=number_slider_2)
lng = ListLength(List=move.Geometry)
vec = VectorXYZ(XComponent=number_slider_5, YComponent=number_slider_6, ZComponent=number_slider_7)  # -> Vector, Length
range = Range(Domain=dom, Steps=expr("x+1", lng))
rot3d = Rotate3D(Geometry=move.Geometry, Angle=degrees(range), Center=Point(0, 0, 0), Axis=vec.Vector)  # -> Geometry, Transform
lng_2 = ListLength(List=move.Geometry)
dom_2 = ConstructDomain(DomainStart=number_slider_11, DomainEnd=number_slider_12)
random = Random(Range=dom_2, Number=lng_2, Seed=Slider(37, range=0..100))
scale = Scale(Geometry=rot3d.Geometry, Center=Point(0, 0, 0), Factor=random)  # -> Geometry, Transform
vec_2 = VectorXYZ(XComponent=number_slider_15, YComponent=number_slider_16, ZComponent=number_slider_17)  # -> Vector, Length
rot3d_2 = Rotate3D(Geometry=scale.Geometry, Angle=degrees(range), Center=Point(0, 0, 0), Axis=vec_2.Vector)  # -> Geometry, Transform

# ---- group: exercise_1 / getGeometryCentriodPoint
volume = Volume(Geometry=rot3d.Geometry)  # -> Volume, Centroid
volume_2 = Volume(Geometry=rot3d_2.Geometry)  # -> Volume, Centroid

# ---- group: exercise_1
sph = Sphere(Base=PlaneXY(0, 0, 0), Radius=1)
number_slider_23 = Slider(0.8, range=0..1)
dom_3 = ConstructDomain(DomainStart=number_slider_3, DomainEnd=number_slider_4)
vec_3 = VectorXYZ(XComponent=number_slider_8, YComponent=number_slider_9, ZComponent=number_slider_10)  # -> Vector, Length
dom_4 = ConstructDomain(DomainStart=number_slider_13, DomainEnd=number_slider_14)
vec_4 = VectorXYZ(XComponent=number_slider_18, YComponent=number_slider_19, ZComponent=number_slider_20)  # -> Vector, Length

# ---- group: exercise_1 / Move Geometry by the value of script
move_2 = Move(Geometry=sph, Motion=Z)  # -> Geometry, Transform

# ---- group: exercise_1 (continued)
lng_3 = ListLength(List=move_2.Geometry)
range_2 = Range(Domain=dom_3, Steps=expr("x+1", lng_3))
rot3d_3 = Rotate3D(Geometry=move_2.Geometry, Angle=degrees(range_2), Center=Point(0, 0, 0), Axis=vec_3.Vector)  # -> Geometry, Transform
lng_4 = ListLength(List=rot3d_3.Geometry)
random_2 = Random(Range=dom_4, Number=lng_4, Seed=Slider(98, range=0..100))

# ---- group: exercise_1 / randomly scale the geometry
scale_2 = Scale(Geometry=rot3d_3.Geometry, Center=Point(0, 0, 0), Factor=random_2)  # -> Geometry, Transform

# ---- group: exercise_1 (continued)
rot3d_4 = Rotate3D(Geometry=scale_2.Geometry, Angle=degrees(range_2), Center=Point(0, 0, 0), Axis=vec_4.Vector)  # -> Geometry, Transform

crv = Curve(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)
srf = Surface(crv)
merge = Merge(Data1=volume.Centroid, Data2=volume_2.Centroid)

# ---- group: exercise_1 / projectPointToGroundSrf
project = ProjectPoint(Point=volume_2.Centroid, Direction=Vector(0, 0, -1), Geometry=srf)  # -> Point, Index

# ---- group: exercise_1 (continued)
ln = Line(StartPoint=merge, EndPoint=project.Point)
pipe = Pipe(Curve=ln, Radius=number_slider_21, Caps=0)
