# Grasshopper definition 02_pointCloud_Script.gh (Grasshopper 1.0.7)

# PointCloud
# Create an empty list
# C# component Creating List format
#    List<DataType> ListName = new List<DataType>();
# 
# C# component Creating Rhino.Geometry<Point3d>
#    Point3d pt = new Point3d(x,y,z); (Of course there are another function overload)
# 
# C# component Array of Data
#    Use Nested Loop
#    for(int i=0;i<x;i++){
#      for(int j=0;j<y;j++){
#        for(int k=0;k<z;k++){
#           }}}
# 
# Adding Geometry to a list
#    ListName.Add(Geometry);
#    ex: pts.Add(new Point3d(x,y,z);
number_slider = Slider(50, range=0..50)
ystep = Slider(2, range=0..10)
zstep = Slider(3, range=0..10)

# ---- group: PointCloud
c_script = CSharpScript(
    xStop=number_slider,
    xStep=Slider(3, range=0..10),
    yStop=Slider(30, range=0..30),
    yStep=ystep,
    zStop=Slider(7, range=0..30),
    zStep=zstep,
    complex=Toggle(True))  # -> out, A; inputs xStop: Int32, xStep: Int32, yStop: Int32, yStep: Int32, zStop: Int32, zStep: Int32, complex: Boolean
# ---------- c_script: C# ----------
    List<Point3d> pts = new List <Point3d>();

    for (int x = 0 ; x < xStop; x += xStep)
    {
      for (int y = 0 ; y < yStop ; y += yStep)
      {
        for (int z = 0 ; z < zStop ; z += zStep)
        {
          if(complex == true)
          {
            pts.Add(new Point3d (x * System.Math.Sin(x), y * System.Math.Cos(y), z * System.Math.Tan(z * z)));
          }
          else
          {
            pts.Add(new Point3d (x, y, z));
          }
        }
      }
    }

    A = pts;
# ---------- end c_script ----------

# ----
pdecon = Deconstruct(Point=c_script.A)  # -> XComponent, YComponent, ZComponent
number_slider_2 = Slider(2, range=0..10)
pt = ConstructPoint(XCoordinate=pdecon.XComponent, YCoordinate=0, ZCoordinate=pdecon.ZComponent)
pt_2 = ConstructPoint(XCoordinate=0, YCoordinate=pdecon.YComponent, ZCoordinate=pdecon.ZComponent)
pt_3 = ConstructPoint(XCoordinate=pdecon.YComponent, YCoordinate=pdecon.YComponent, ZCoordinate=pdecon.ZComponent)
pt_4 = ConstructPoint(XCoordinate=pdecon.XComponent, YCoordinate=pdecon.YComponent, ZCoordinate=0)
arrpolar = PolarArray(Geometry=pt_4, Plane=pt_2, Count=number_slider_2, Angle=6.283185307)  # -> flatten(Geometry), Transform
arrpolar_2 = PolarArray(Geometry=pt, Plane=pt_2, Count=number_slider_2, Angle=6.283185307)  # -> flatten(Geometry), Transform
arrpolar_3 = PolarArray(Geometry=pt_3, Plane=pt_3, Count=number_slider_2, Angle=6.283185307)  # -> flatten(Geometry), Transform
del = DelaunayMesh(Points=arrpolar.Geometry, Plane=PlaneXY(0, 0, 0))
del_2 = DelaunayMesh(Points=arrpolar_2.Geometry, Plane=PlaneXY(0, 0, 0))
del_3 = DelaunayMesh(Points=arrpolar_3.Geometry, Plane=PlaneXY(0, 0, 0))
