# Grasshopper definition 03_basicMath.gh (Grasshopper 1.0.7)

number_slider = Slider(5, range=0..10)

number_slider_2 = Slider(5, range=0..10)
c_script = CSharpScript(input=number_slider_2)  # -> negativeValue, absoluteValue, Factorial; inputs input: Double
# ---------- c_script: C# ----------
    double n = input * (-1);
    double abs = Math.Abs(input);
    double f = input;
    for (double i = input-1 ; i >= 1;i--){
      f = f * i;
    }

    //output the result
    negativeValue = n;
    absoluteValue = abs;
    Factorial = f;
# ---------- end c_script ----------
fac = Factorial(Number=number_slider_2)
neg = Negative(Value=number_slider_2)
abs = Absolute(Value=number_slider_2)
panel = Panel([c_script.negativeValue, c_script.absoluteValue, c_script.Factorial])
panel_2 = Panel([neg, abs, fac])

panel_3 = Panel("""1
2
3
4
5""")
c_script_2 = CSharpScript(inputList=panel_3)  # -> MassAdditionResult, MassMultiplyResult, AdditionPartition, MultiplyPartition; inputs inputList: list of Double
# ---------- c_script_2: C# ----------
    double massAddition = 0;
    double massMultiply = 1;

    //calculate mass addition
    for (int i = 0 ; i < inputList.Count; i++)   massAddition += inputList[i];
    MassAdditionResult = massAddition;

    //calculate mass multiply
    for (int i = 1 ; i < inputList.Count; i++) massMultiply *= inputList[i];
    MassMultiplyResult = massMultiply;

    massAddition = 0;
    //get mass addition partition
    List<double> additionPartition = new List<double>();
    for (int i = 0; i < inputList.Count; i++)
    {
      massAddition += inputList[i];
      additionPartition.Add(massAddition);
    }

    massMultiply = 1;
    //get mass multiply partition
    List<double> multiplyPartition = new List<double>();
    for (int i = 0; i < inputList.Count; i++)
    {
      massMultiply *= inputList[i];
      multiplyPartition.Add(massMultiply);
    }

    //output result
    AdditionPartition = additionPartition;
    MultiplyPartition = multiplyPartition;
# ---------- end c_script_2 ----------
mm = MassMultiplication(Input=panel_3)  # -> Result, PartialResults
ma = MassAddition(Input=panel_3)  # -> Result, PartialResults
panel_4 = Panel(c_script_2.MassMultiplyResult)
panel_5 = Panel(mm.Result)
panel_6 = Panel(c_script_2.AdditionPartition)
panel_7 = Panel(ma.PartialResults)
panel_8 = Panel(c_script_2.MultiplyPartition)
panel_9 = Panel(mm.PartialResults)

equals = Equality(FirstNumber="3", SecondNumber="5")  # -> Equality, Inequality
larger = LargerThan(FirstNumber="3", SecondNumber="3")  # -> LargerThan, OrEqualTo
smaller = SmallerThan(FirstNumber="3", SecondNumber="5")  # -> SmallerThan, OrEqualTo
c_script_3 = CSharpScript(x="5", y="3")  # -> out, Equal, Not_Equal, Larger_Than, Larger_equal, Smaller_Than, Smaller_equal; inputs x: Double, y: Double
# ---------- c_script_3: C# ----------
    bool state = true;
    bool smaller = true;
    bool larger = true;

    if (x == y){
      state = true;
    }
    if(x < y || x <= y){
      smaller = true;
    }
    else{
      smaller = false;
    }
    if(x > y || x >= y){
      larger = true;
    }
    else{
      larger = false;
    }

    Equal = state;
    Not_Equal = !state;
    Smaller_Than = smaller;
    Smaller_equal = smaller;
    Larger_equal = larger;
    Larger_Than = larger;
# ---------- end c_script_3 ----------
panel_10 = Panel(c_script_3.Larger_Than)

# ---- group: Operators
number_slider_3 = Slider(2, range=0..10)
number_slider_4 = Slider(5, range=0..10)
c_script_4 = CSharpScript(x=number_slider_4, y=number_slider)  # -> out, AdditonResult, MinusResult, MultiplyResult, DivideResult, PowerResult, ModulusResult, Interger_Divide; inputs x: Double, y: Double
# ---------- c_script_4: C# ----------
    double addition = x + y;
    double minus = x - y;
    double multiply = x * y;
    double divide = x / y;
    double power = Math.Pow(x, y);
    double modulus = x % y;
    double intgDivide = Math.Floor(x / y);
    

    //Output
    AdditonResult = addition;
    MinusResult = minus;
    MultiplyResult = multiply;
    DivideResult = divide;
    PowerResult = power;
    ModulusResult = modulus;
    Interger_Divide = intgDivide;
# ---------- end c_script_4 ----------
addition = Addition(A=number_slider_4, B=number_slider_3)
subtraction = Subtraction(A=number_slider_4, B=number_slider_3)
multiplication = Multiplication(A=number_slider_4, B=number_slider_3)
division = Division(A=number_slider_4, B=number_slider_3)
pow = Power(A=number_slider_4, B=number_slider_3)
panel_11 = Panel([c_script_4.AdditonResult, c_script_4.MinusResult, c_script_4.MultiplyResult, c_script_4.DivideResult, c_script_4.PowerResult, c_script_4.ModulusResult, c_script_4.Interger_Divide])

# ----
mod = Modulus(A=number_slider_4, B=number_slider)
integer_division = IntegerDivision(A=number_slider_4, B=number_slider)

# ---- group: Operators (continued)
panel_12 = Panel([addition, subtraction, multiplication, division, pow, mod, integer_division])
